% Simulink data dictionary Trans_ctrl.sldd

Iei = 0.02199149
TWAIT = 2

UP_TABLE = [10 30 50 1000000
 10 30 50 1000000
 15 30 50 1000000
 23 41 60 1000000
 40 70 100 1000000
 40 70 100 1000000]

UP_TH_BP = [0; 25; 35; 50; 90; 100]

DOWN_TABLE = [0 5 20 35
 0 5 20 35
 0 5 25 40
 0 5 30 50
 0 30 50 80
 0 30 50 80]

DOWN_TH_BP = [0; 5; 40; 50; 90; 100]

Converter_data = [0 137.4652 2.232
 0.1 137.065 2.075
 0.2 135.8644 1.975
 0.3 135.6644 1.846
 0.4 137.5653 1.72
 0.5 140.3666 1.564
 0.6 145.2689 1.409
 0.7 152.8725 1.254
 0.8 162.9773 1.096
 0.81 164.2779 1.08
 0.82 166.1788 1.061
 0.83 167.9797 1.043
 0.84 170.0807 1.028
 0.85 172.782 1.012
 0.86 175.3832 1.002
 0.87 179.5852 1.002
 0.88 183.5871 1.001
 0.89 189.8901 0.998
 0.9 197.6938 0.999
 0.92 215.9024 1.001
 0.94 244.516 1.002]

Vehicle_data = [3.23; 40; 0.02; 1; 12.09415; 0]